# Grasshopper definition drawingcreater.gh (Grasshopper 0.9.76)
# plug-ins: Python Interpreter, Human UI

# ---- group: ウィンドウ展開
run = BooleanToggle(False)

# ---- group: 断面位置
crv = Curve()

# ---- group: 高さ0として扱う点
pt = Point()

# ----
radiobtn = CreateRadioButton(RadioButtonName="配置図(断面位置図)", RadioButtonGroup="モード選択", InitiallySelected=False)
radiobtn_2 = CreateRadioButton(RadioButtonName="平面図のみ", RadioButtonGroup="モード選択", InitiallySelected=True)
radiobtn_3 = CreateRadioButton(RadioButtonName="断面図のみ", RadioButtonGroup="モード選択", InitiallySelected=False)
radiobtn_4 = CreateRadioButton(RadioButtonName="平面図＆断面図", RadioButtonGroup="モード選択", InitiallySelected=False)
tb = CreateTextBlock(Text="□モード選択ーーーーーーーーーーーーーーーーーーーーーーー", TextSize=16, Justification=0)
values = ValueListener(Elements=radiobtn_2, SomeProperty=True)  # -> Values, Indices
values_2 = ValueListener(Elements=radiobtn_3, SomeProperty=True)  # -> Values, Indices
values_3 = ValueListener(Elements=radiobtn_4, SomeProperty=True)  # -> Values, Indices
values_4 = ValueListener(Elements=radiobtn, SomeProperty=True)  # -> Values, Indices
merge = Merge(Data1=values.Values, Data2=values_2.Values, Data3=values_3.Values, Data4=values_4.Values)
toggle = BooleanToggle(True)
toggle_2 = BooleanToggle(False)
mindex = MemberIndex(Set=merge, Member=Toggle(True))  # -> Index, Count
stack = CreateStack(UIElements=[radiobtn_4, radiobtn], Horizontal=True)
stack_2 = CreateStack(UIElements=[radiobtn_2, radiobtn_3], Horizontal=True)
merge_2 = Merge(Data1=toggle, Data2=toggle)
merge_3 = Merge(Data1=toggle, Data2=toggle_2)
merge_4 = Merge(Data1=toggle_2, Data2=toggle)
merge_5 = Merge(Data1=toggle_2, Data2=toggle_2)
サーフェスの大きさ = Slider(50000, range=-1..1000000)
filter = StreamFilter(Gate=mindex.Index, Stream0=merge_3, Stream1=merge_4, Stream2=merge_2, Stream3=merge_5)
item = ListItem(List=filter, Index=0, Wrap=True)  # -> Item, Item1
目印の大きさ = Slider(29, range=5..100)
panel = Panel("""3dm
dwg""")
slider = CreateSlider(
    Slider=サーフェスの大きさ,
    SnapValue=Slider(10000, range=0..10000),
    ShowBounds=False,
    showLabel=False,
    ShowTicks=False,
    ShowTooltip=False,
    ShowValLabel=False)
bool = Boolean(item.Item)
bool_2 = Boolean(item.Item1)
radiobtn_5 = CreateRadioButton(RadioButtonName="精度優先", RadioButtonGroup="スピード選択", InitiallySelected=False)
radiobtn_6 = CreateRadioButton(RadioButtonName="速度優先", RadioButtonGroup="スピード選択", InitiallySelected=True)
slider_2 = CreateSlider(Slider=目印の大きさ, ShowBounds=False, showLabel=False, ShowTicks=False, ShowTooltip=False, ShowValLabel=False)
cmdbutton = CreateRhinoCommandButton(ButtonName="AcadSchemes", RhinoScript="AcadSchemes", ButtonStyle=0)
filepicker = CreateFilePicker(ButtonLabelText="browse", DialogType=2, MustExist=True, Filter="All Files|*.*")
textbox = CreateTextBox(DefaultText="project", UpdateButton=True, showLabel=False)
tb_2 = CreateTextBlock(Text="□設定ーーーーーーーーーーーーーーーーーーーーーーーーーー", TextSize=16, Justification=0)
pulldown = CreatePulldownMenu(ListItems=panel, showLabel=True)
tb_3 = CreateTextBlock(Text="□実行ーーーーーーーーーーーーーーーーーーーーーーーーーーー", TextSize=16, Justification=0)
textbox_2 = CreateTextBox(DefaultText="-2000/0/2000", UpdateButton=True, showLabel=True)
expander = CreateExpander(UIElements=slider, Header="目印の大きさ", Open=False)
tb_4 = CreateTextBlock(Text="□断面図ーーーーーーーーーーーーーーーーーーーーーーーーー", TextSize=16, Justification=0)
values_5 = ValueListener(Elements=slider, SomeProperty=True)  # -> Values, Indices
expander_2 = CreateExpander(UIElements=slider_2, Header="目印の大きさ", Open=False)
values_6 = ValueListener(Elements=textbox_2, SomeProperty=True)  # -> Values, Indices
tb_5 = CreateTextBlock(Text="□平面図ーーーーーーーーーーーーーーーーーーーーーーーーー", TextSize=16, Justification=0)
expander_3 = CreateExpander(UIElements=textbox_2, Header="高さの指定", Open=False)
dam = DataDam(DataA=values_5.Values, BufferDelay=10000000, BufferMode=2)
values_7 = ValueListener(Elements=radiobtn_6, SomeProperty=True)  # -> Values, Indices
values_8 = ValueListener(Elements=radiobtn_5, SomeProperty=True)  # -> Values, Indices
stack_3 = CreateStack(UIElements=[radiobtn_6, radiobtn_5], Horizontal=True)
setslider = SetSlider(UISlider=slider, Value=values_5.Values)
expander_4 = CreateExpander(UIElements=textbox, Header="保存名", Open=False)
expander_5 = CreateExpander(UIElements=filepicker, Header="保存先", Open=False)
values_9 = ValueListener(Elements=textbox, SomeProperty=True)  # -> Values, Indices
values_10 = ValueListener(Elements=filepicker, SomeProperty=True)  # -> Values, Indices
expander_6 = CreateExpander(UIElements=pulldown, Header="保存形式", Open=False)
values_11 = ValueListener(Elements=pulldown, SomeProperty=True)  # -> Values, Indices
values_12 = ValueListener(Elements=slider_2, SomeProperty=True)  # -> Values, Indices
expander_7 = CreateExpander(UIElements=cmdbutton, Header="dwgに書き出す設定を変更する", Open=False)
merge_6 = Merge(Data1=values_7.Values, Data2=values_8.Values)
division = Division(A=dam, B=2)
split = TextSplit(Text=values_6.Values, Separators="/")
setslider_2 = SetSlider(UISlider=slider_2, Value=values_12.Values)
panel_2 = Panel("""slow
fast""")
dam_2 = DataDam(DataA=values_12.Values, BufferDelay=10000000, BufferMode=2)
neg = Negative(Value=division)
toggle_3 = CreateToggle(Default=False, OnLabel=" on", OffLabel=" off")
mindex_2 = MemberIndex(Set=merge_6, Member=Toggle(False))  # -> Index, Count
int = Integer(split)
len = TextLength(Text=values_10.Values)
dom = ConstructDomain(DomainStart=division, DomainEnd=neg)
equals = Equality(FirstNumber=len, SecondNumber="0")  # -> Equality, Inequality
item_2 = ListItem(List=panel_2, Index=mindex_2.Index, Wrap=True)
filter_2 = StreamFilter(Gate=equals.Equality, Stream0=values_10.Values, Stream1="D:\default\")
txt = Text(item_2)
values_13 = ValueListener(Elements=toggle_3, SomeProperty=True)  # -> Values, Indices
tb_6 = CreateTextBlock(Text="offにしてください", TextSize=12, Justification=0)
concat = Concatenate(FragmentA=filter_2, FragmentB="\")
bool_3 = Boolean(values_13.Values)
adjustelem = AdjustElementAppearance(
    ElementsToAdjust=tb_6,
    Foreground=ColourSwatch(SwatchColor=RGB(255, 255, 255)),
    Background=ColourSwatch(SwatchColor=RGB(255, 0, 0)))
hideshow = HideShowElement(ElementToHideShow=tb_6, Show=bool_3, Collapse=True, Disable=False)
accent_colors = ValueList({"Amber", "Blue", "Brown", "Cobalt", "Crimson", "Cyan", "Emerald", "Green", "Indigo", "Lime", "Magenta", "Mauve", "Olive", "Orange", "Pink", "Purple", "Red", "Sienna", "Steel", "Taupe", "Teal", "Violet", "Yellow"}, selected="Steel")
hideshow_2 = HideShowElement(ElementToHideShow=tb_5, Show=bool, Collapse=True, Disable=False)
hideshow_3 = HideShowElement(ElementToHideShow=expander_3, Show=bool, Collapse=True, Disable=False)
hideshow_4 = HideShowElement(ElementToHideShow=expander, Show=bool, Collapse=True, Disable=False)
hideshow_5 = HideShowElement(ElementToHideShow=tb_4, Show=bool_2, Collapse=True, Disable=False)
hideshow_6 = HideShowElement(ElementToHideShow=expander_2, Show=bool_2, Collapse=True, Disable=False)
launchwin = LaunchWindow(
    Show=run,
    Name="Plan&Section",
    Width=Slider(370, range=0..1000),
    Height=Slider(690, range=0..1000),
    ChildStatus=0,
    EnableHorizScroll=False)

# ---- group: モード
data = Data(mindex.Index)

# ----
winprops = SetWindowProperties(Window=launchwin, Theme=0, AccentColor=accent_colors, ShowTitleBar=True, ScaleFactor=1)
data_2 = Data(stack)
data_3 = Data(tb_5)
data_4 = Data(expander_3)
data_5 = Data(expander)
data_6 = Data(expander_5)
data_7 = Data(expander_7)
data_8 = Data(tb_3)
data_9 = Data(stack_3)
data_10 = Data(tb)
data_11 = Data(stack_2)
data_12 = Data(tb_4)
data_13 = Data(expander_2)
data_14 = Data(tb_2)
data_15 = Data(expander_4)
data_16 = Data(expander_6)
data_17 = Data(toggle_3)
data_18 = Data(tb_6)

# ---- group: 平面図高さ
data_19 = Data(int)

# ---- group: サーフェス大きさ
data_20 = Data(dom)

# ---- group: 実行
data_21 = Data(bool_3)

# ---- group: 速度か精度か
data_22 = Data(txt)

# ---- group: 保存形式
data_23 = Data(values_11.Values)

# ---- group: ディレクトリ
data_24 = Data(concat)

# ---- group: 保存名
data_25 = Data(values_9.Values)

# ---- group: 断面図目印
data_26 = Data(dam_2)

# ----
panel_3 = Panel("""C:以外を指定すること
英数字・記号のみ使用可能""")
panel_4 = Panel("""選択した点の高さを0として平面図を作成する高さを指定する。
○○○/×××/▲▲▲のかたちで記入。""")
tooltip = AttachTooltipToElement(ElementsToAttachTo=data_13, TooltipContent="断面を見る方向の目印の大きさを指定。", ShowDelay=500, Duration=20000)
tooltip_2 = AttachTooltipToElement(ElementsToAttachTo=data_15, TooltipContent="英数字・記号のみ使用可能", ShowDelay=500, Duration=20000)
tooltip_3 = AttachTooltipToElement(ElementsToAttachTo=data_6, TooltipContent=panel_3, ShowDelay=500, Duration=20000)
tooltip_4 = AttachTooltipToElement(ElementsToAttachTo=data_4, TooltipContent=panel_4, ShowDelay=500, Duration=20000)
tooltip_5 = AttachTooltipToElement(ElementsToAttachTo=data_5, TooltipContent="高さの目印になるサーフェスの大きさを指定。", ShowDelay=500, Duration=20000)
xy = XYPlane(Origin=Point(0, 0, 0))
crv_2 = Curve(crv)
project = Project(Geometry=crv, Plane=xy)  # -> Geometry, Transform
lng = ListLength(List=crv_2)
crv_3 = Curve(project.Geometry)
end = EndPoints(Curve=crv_2)  # -> Start, End
series = Series(Start=0, Step=1, Count=lng)
explode = Explode(Curve=crv_3, Recursive=True)  # -> Segments, Vertices
merge_7 = Merge(Data1=graft(end.Start), Data2=graft(end.End))
int_2 = Integer(series)
pline = PolyLine(Vertices=explode.Vertices, Closed=False)
tag = TextTag3D(Location=merge_7, Text=graft(int_2), Size=Slider(1960, range=0..4010), Justification=7)
crv_4 = Curve(flatten(pline))

# ---- group: よこ
adjustpos = AdjustElementPositioning(
    ElementsToAdjust=[data_4, data_5, data_13, data_15, data_6, data_16, data_7],
    Margin=Slider(4, range=0..10),
    AbsolutePositioning=False,
    Width=Slider(320, range=0..1000),
    HorizontalAlignment=0)

# ----
adjustelem_2 = AdjustElementAppearance(
    ElementsToAdjust=[data_3, data_12, data_14, data_9, data_10, data_8],
    Foreground=ColourSwatch(SwatchColor=RGB(163, 0, 0)))

# ---- group: ディレクトリ
adjustpos_2 = AdjustElementPositioning(
    ElementsToAdjust=filepicker,
    Margin=Slider(4, range=0..100),
    AbsolutePositioning=False,
    Width=Slider(300, range=0..1000),
    Height=Slider(35, range=0..1000),
    HorizontalAlignment=0)

# ---- group: 中身
adjustpos_3 = AdjustElementPositioning(
    ElementsToAdjust=textbox,
    AbsolutePositioning=False,
    Width=Slider(300, range=0..1000),
    Height=Slider(27, range=0..1000),
    HorizontalAlignment=0)

# ----
pt_2 = Point(pt)
crv_5 = Curve(crv_4)
panel_5 = Panel("""main
debug""")
python = PythonScript(
    point_p=pt_2,
    curve_s=crv_5,
    mode=data,
    height=data_19,
    mark=data_26,
    name=data_25,
    directory=data_24,
    extension=data_23,
    speed=data_22,
    draw=data_21)  # -> out, direction, center, len_p, len_s; inputs curve_s: list of Curve, mode: Int32, height: list
# ---------- python: Python ----------
# -*- coding: utf-8 -*-
import rhinoscriptsyntax as rs
import scriptcontext as sc
import Rhino
import os
import time
from math import sqrt

len_p = str(len(height)) + " 枚の平面図を生成します"
len_s = str(len(curve_s)) + " 枚の断面図を生成します"

# 平面図の基準点を作成
def MakePlanPreview(num):
	points = [(0, 0, 0 + i) for i in num]
	vec_p = [rs.VectorCreate(i, (0,0,0)) for i in points]
	guid = []
	origin = []
	for i in vec_p:
		guid.append(rs.CopyObject(point_p, i))
	for i in guid:
		origin.append(rs.coerce3dpoint(i))# ガイドから3dpointに変換
	return origin

# 断面を見る方向を示す目印を作る
def MakeSectionPreview(line, size):
	arrow = []# 目印を格納するリスト
	for i in range(len(line)):
		vec_x = rs.VectorCreate(rs.CurveStartPoint(line[i]), rs.CurveEndPoint(line[i]))
		vec_y = rs.VectorUnitize(rs.VectorCrossProduct(vec_x, [0,0,1]))
		pt3 = rs.DivideCurve(line[i], size)
		seglen = rs.Distance(pt3[0], pt3[1])
		tri_s = [rs.AddPoint(pt3[i]) for i in range(3)]
		tri_e = [rs.AddPoint(pt3[len(pt3) - i]) for i in range(1, 4)]
		rs.MoveObject(tri_s[1], vec_y * (seglen * sqrt(3)))
		rs.MoveObject(tri_e[1], vec_y * (seglen * sqrt(3)))
		arrow.append(rs.AddInterpCurve(rs.coerce3dpointlist(tri_s), 1))
		arrow.append(rs.AddInterpCurve(rs.coerce3dpointlist(tri_e), 1))
	return arrow

if mode == 0 or mode == 2:# モードが平面図のみor両方のとき
	center = MakePlanPreview(height)
	print("■previewed plan■")
if mode == 1 or mode == 2:# モードが断面図のみor両方のとき
	direction = MakeSectionPreview(curve_s, mark)
	print("■previewed section■")

if draw:
	print("//////////start drawing//////////")

	# "Make2D"レイヤーが存在するか確認する
	def ConfirmLayer():
		print("■start confirmlayer■")
		sc.doc = Rhino.RhinoDoc.ActiveDoc
		layers = rs.LayerNames()
		if "Make2D" in layers:
			dellayer = rs.MessageBox("既に存在する'Make2D'レイヤーは削除されます　問題ないですか？", 4, "レイヤーの確認")
			if dellayer == int(6):# Massageboxのはいは6で返却される
				rs.DeleteLayer("Make2D")# 作図中にMake2Dレイヤーが作成されるため、前もって削除
				layer = True
				print("deleted layer")
			else:
				rs.MessageBox("作図をキャンセルしました")
				layer = False
				print("canceled writing")
		else:
			layer = True
			print("no make2d layer")
		sc.doc = ghdoc
		print("■end confirmfolder■")
		return layer# "Make2D"レイヤーが存在しないor削除するときはTrueを返却
				
	# 指定のフォルダが存在するか確認する
	def Confirmfolder(dir):
		print("■start confirmfolder■")
		if os.path.exists(str(dir)):# 指定したフォルダが存在するか確認
			folder = True
			print("confirmedfolder")
		else:
			newfolder = rs.MessageBox("指定したフォルダが存在しません(" + str(dir) + ")　フォルダを新規作成しますか？", 4, "フォルダの確認")
			if newfolder == int(6):# Massageboxのはいは6で返却される
				os.mkdir(str(dir))# 指定したディレクトリにフォルダを新規作成
				folder = True
				print("makingnewfolder")
			else:
				rs.MessageBox("作図をキャンセルしました")
				folder = False
				print("canceled writing")
		print("■end confirmfolder■")
		return folder# フォルダを作成orすでに存在したらTrueで返却

	# ファイル名に重複がないか確認する
	def ConfirmDup(dir, nam, height, line, switch, extension):
		print("■start confirmdup■")
		
		# 平面図の確認
		def Planduplicate(dire, name, num_plan, exte):
			result = []
			for i in num_plan:
				if i > 0:
					i = "+" + str(i)
				result.append(os.path.exists(str(dire) + str(name) + "_plan_" + str(i) + "." + str(exte)))
			return result

		# 断面図の確認
		def SecDuplicate(dire, name, num_sec, exte):
			result = []
			for i in range(len(num_sec)):
				result.append(os.path.exists(str(dire) + str(name) + "_section_" + str(i) + "." + str(exte)))
			return result

		# 配置図の確認
		def RoofDuplicate(dire, name, exte):
			result = []
			result.append(os.path.exists(str(dire) + str(name) + "_roof" + "." + str(exte)))
			return result

		dup_p = []# ダブリがある場合はTrue、ない場合はFalseが格納されるリスト
		dup_s = []
		dup_r = []
		if switch == 0 or switch == 2:# モードが平面図のみor両方のとき
			dup_p.extend(Planduplicate(dir, nam, height, extension))
		if switch == 1 or switch == 2:# モードが断面図のみor両方のとき
			dup_s.extend(SecDuplicate(dir, nam, line, extension))
		dup_r.extend(RoofDuplicate(dir, nam, extension))

		if True in dup_p or True in dup_s or True in dup_r:# 一個でも重複する場合
			print("duplicate files" + " p = " + str(dup_p.count(True)) + " s = " + str(dup_s.count(True)) + " r = " + str(dup_r.count(True)))
			if switch == 0 or switch == 1 or switch == 2:
				ans = rs.MessageBox("同じ名前のファイルが存在します  平面図:" + str(dup_p.count(True)) + "枚 " + "断面図:" + str(dup_s.count(True)) + "枚  上書きしますか？", 4, "ファイルの重複")
				if ans == int(6):# Massageboxのはいは6で返却される
					duplicate = True
					print("overwriting")
				else:
					rs.MessageBox("作図をキャンセルしました")
					duplicate = False
					print("canceled writing")
			elif switch == 3:
				ans = rs.MessageBox("同じ名前のファイルが存在します  上書きしますか？", 4, "ファイルの重複")
				if ans == int(6):# Massageboxのはいは6で返却される
					duplicate = True
					print("overwriting")
				else:
					rs.MessageBox("作図をキャンセルしました")
					duplicate = False
					print("canceled writing")
		else:
			duplicate = True
			print("no duplicate")
		print("■end confirmdup■")
		return duplicate# 重複が存在しないor上書きする場合はTrueで返却

	# "X座標,Y座標,Z座標"と入力用の文を作る
	def ConvertPt(pt3d):
		text = (str(pt3d[0]) + "," + str(pt3d[1]) + "," + str(pt3d[2]))
		return text

	# 平面図を作成
	def MakePlan(num, pt, dir, nam, mode, ext):
		count = 0
		while count != len(num):
			s = time.time()
			print("making no." + str(count) + " plan")
			rs.Command("_CPlane " + "_T " + ConvertPt(pt[count]))
			rs.Command("_ClippingPlane " + "_C " + "0,0,0" + " " + str(1000) + " " + str(1000) + " ")
			rs.Command("_Plan")
			rs.Command("_SelAll")
			rs.Command("_Zoom " + "_S ")
			rs.Command("_SelNone")
			if mode == "fast":
				rs.Command("_SelVisible " + "_Enter")
			if mode == "slow":
				rs.Command("_SelAll")
			sc.doc = Rhino.RhinoDoc.ActiveDoc
			select = len(rs.SelectedObjects())
			sc.doc = ghdoc
			print("selected " + str(select) + " objects")
			if select == 0:
				print("canceled")
			else:
				rs.Command("-_Make2d " + "_D " + "_C " + "_M=はい " + "_Enter")
				rs.Command("_CPlane " + "_W " + "_T ")
				if num[count] > 0:
					end = "+" + str(num[count])
				else:
					end = num[count]
				if ext == "dwg":
					rs.Command("-_Export " + dir + nam + "_plan_" + str(end) + ".dwg" + " " + "_Enter")
				else:
					rs.Command("-_Export " + dir + nam + "_plan_" + str(end) + "." + str(ext))
				rs.Command("_SelCrv")
				print("exported plan")
			rs.Command("_SelClippingPlane")
			rs.Command("_Delete")
			print("time = " + str(time.time() - s))
			print("completed no." + str(count) + " plan")
			count += 1

	# 断面図を作成(折れ曲がらない切断線のとき)
	def MakeSimpleSec(dir, nam, num, line, mode, ext):
		s = time.time()
		rs.Command("_CPlane " + "_W " + "_T ")
		rs.Command("_CPlane " + "_I " + ConvertPt(rs.CurveStartPoint(line)) + " " + "_V " + ConvertPt(rs.CurveEndPoint(line)) + " ")
		rs.Command("_Clippingplane " + "_C " + "0,0,0" + " " + str(1000) + " " + str(1000) + " ")
		rs.Command("_Plan")
		rs.Command("_SelAll")
		rs.Command("_Zoom " + "_S ")
		rs.Command("_SelNone")
		if mode == "fast":
			rs.Command("_SelVisible " + "_Enter")
		elif mode == "slow":
			rs.Command("_SelAll")
		sc.doc = Rhino.RhinoDoc.ActiveDoc
		select = len(rs.SelectedObjects())
		sc.doc = ghdoc
		print("selected " + str(select) + " objects")
		if select == 0:
			print("canceled")
		else:
			rs.Command("-_Make2d " + "_D " + "_C " + "_M=はい " + "_Enter")
			rs.Command("_CPlane " + "_W " + "_T ")
			if ext == "dwg":
				rs.Command("-_Export " + dir + nam + "_section_" + str(num) + ".dwg" + " " + "_Enter")
			else:
				rs.Command("-_Export " + dir + nam + "_section_" + str(num) + "." + str(ext))
			print("exported section")
			rs.Command("_SelCrv")
		rs.Command("_SelClippingPlane")
		rs.Command("_Delete")
		print("time = " + str(time.time() - s))

	# 断面図を作成(折れ曲がる切断線のとき)
	def MakeComplexSec(dir, nam, num, line, mode, ext):
		s = time.time()
		segment = range(0, len(rs.ExplodeCurves(line)), 2)
		rs.Command("_CPlane " + "_W " + "_T ")
		for i in segment:
			print("segment num = " + str(i))
			if i == 0:
				rs.Command("_CPlane " + "_I " + ConvertPt(rs.CurveStartPoint(rs.ExplodeCurves(line)[i])) + " " + "_V " + ConvertPt(rs.CurveEndPoint(rs.ExplodeCurves(line)[i])) + " ")
				rs.Command("_ClippingPlane " + "_C " + "0,0,0" + " " + str(1000) + " " + str(1000) + " ")
				rs.Command("_CPlane " + "_W " + "_T")
				rs.Command("_CPlane " + "_I " + ConvertPt(rs.CurveEndPoint(rs.ExplodeCurves(line)[i])) + " " + "_Z " + ConvertPt(rs.CurveStartPoint(rs.ExplodeCurves(line)[i])) + " ")
				rs.Command("_CPlane " + "_R " + "_Y " + "180")
				rs.Command("_ClippingPlane " + "_C " + "0,0,0" + " " + str(1000) + " " + str(1000) + " ")
			elif i == segment[-1]:
				rs.Command("_CPlane " + "_I " + ConvertPt(rs.CurveStartPoint(rs.ExplodeCurves(line)[i])) + " " + "_V " + ConvertPt(rs.CurveEndPoint(rs.ExplodeCurves(line)[i])) + " ")
				rs.Command("_ClippingPlane " + "_C " + "0,0,0" + " " + str(1000) + " " + str(1000) + " ")
				rs.Command("_CPlane " + "_W " + "_T")
				rs.Command("_CPlane " + "_I " + ConvertPt(rs.CurveStartPoint(rs.ExplodeCurves(line)[i])) + " " + "_Z " + ConvertPt(rs.CurveEndPoint(rs.ExplodeCurves(line)[i])) + " ")
				rs.Command("_CPlane " + "_R " + "_Y " + "180")
				rs.Command("_ClippingPlane " + "_C " + "0,0,0" + " " + str(1000) + " " + str(1000) + " ")
			else:
				rs.Command("_CPlane " + "_I " + ConvertPt(rs.CurveStartPoint(rs.ExplodeCurves(line)[i])) + " " + "_V " + ConvertPt(rs.CurveEndPoint(rs.ExplodeCurves(line)[i])) + " ")
				rs.Command("_ClippingPlane " + "_C " + "0,0,0" + " " + str(1000) + " " + str(1000) + " ")
				rs.Command("_CPlane " + "_W " + "_T")
				rs.Command("_CPlane " + "_I " + ConvertPt(rs.CurveEndPoint(rs.ExplodeCurves(line)[i])) + " " + "_Z " + ConvertPt(rs.CurveStartPoint(rs.ExplodeCurves(line)[i])) + " ")
				rs.Command("_ClippingPlane " + "_C " + "0,0,0" + " " + str(1000) + " " + str(1000) + " ")
				rs.Command("_CPlane " + "_W " + "_T")
				rs.Command("_CPlane " + "_I " + ConvertPt(rs.CurveStartPoint(rs.ExplodeCurves(line)[i])) + " " + "_Z " + ConvertPt(rs.CurveEndPoint(rs.ExplodeCurves(line)[i])) + " ")
				rs.Command("_CPlane " + "_R " + "_Y " + "180")
				rs.Command("_ClippingPlane " + "_C " + "0,0,0" + " " + str(1000) + " " + str(1000) + " ")
			rs.Command("_CPlane " + "_W " + "_T")
			rs.Command("_CPlane " + "_I " + ConvertPt(rs.CurveStartPoint(rs.ExplodeCurves(line)[0])) + " " + "_V " + ConvertPt(rs.CurveEndPoint(rs.ExplodeCurves(line)[0])) + " ")
			rs.Command("_Plan")
			rs.Command("_SelAll")
			rs.Command("_Zoom " + "_S ")
			rs.Command("_SelNone")
			rs.Command("_SelVisible " + "_Enter")
			sc.doc = Rhino.RhinoDoc.ActiveDoc
			select = len(rs.SelectedObjects())
			sc.doc = ghdoc
			print("selected " + str(select) + " objects")
			if select == 0:
				print("canceled")
			else:
				rs.Command("-_Make2d " + "_D " + "_U " + "_M=はい " + "_Enter")
				rs.Command("_Hide")
			rs.Command("_CPlane " + "_W " + "_T ")
			rs.Command("_SelClippingPlane")
			rs.Command("_Delete")
		rs.Command("_CPlane " + "_I " + ConvertPt(rs.CurveStartPoint(rs.ExplodeCurves(line)[0])) + " " + "_V " + ConvertPt(rs.CurveEndPoint(rs.ExplodeCurves(line)[0])) + " ")
		rs.Command("_Show")
		rs.Command("_SelCrv")
		rs.Command("_Zoom " + "_S ")
		sc.doc = Rhino.RhinoDoc.ActiveDoc
		select = len(rs.SelectedObjects())
		sc.doc = ghdoc
		print("selected " + str(select) + " objects")
		if select == 0:
			print("canceled")
		else:
			rs.Command("-_Make2d " + "_D " + "_C " + "_M=はい " + "_Enter")
			rs.Command("_CPlane " + "_W " + "_T ")
			if ext == "dwg":
				rs.Command("-_Export " + dir + nam + "_section_" + str(num) + ".dwg" + " " + "_Enter")
			else:
				rs.Command("-_Export " + dir + nam + "_section_" + str(num) + "." + str(ext))
		rs.Command("_SelCrv")
		rs.Command("_Delete")
		print("time = " + str(time.time() - s))

	# 配置図(断面位置図)の作成
	def MakeRoofPlan(dir, nam, mode, ext):
		s = time.time()
		rs.Command("_Plan")
		rs.Command("_SelCrv")
		rs.Command("_Invert")
		rs.Command("_Zoom " + "_S ")
		rs.Command("_SelNone")
		rs.Command("_SelCrv")
		sc.doc = Rhino.RhinoDoc.ActiveDoc
		select = len(rs.SelectedObjects())
		sc.doc = ghdoc
		print("selected " + str(select) + " objects")
		if select == 0:
			print("canceled")
		else:
			rs.Command("-_Make2d " + "_D " + "_U " + "_M=はい " + "_Enter")
			rs.Command("_Lock")
			rs.Command("_SelCrv")
			rs.Command("_Hide")
			if mode == "fast":
				rs.Command("_SelVisible " + "_Enter")
			elif mode == "slow":
				rs.Command("_SelAll")
			sc.doc = Rhino.RhinoDoc.ActiveDoc
			select = len(rs.SelectedObjects())
			sc.doc = ghdoc
			print("selected " + str(select) + " objects")
			if select == 0:
				print("canceled")
			else:
				rs.Command("-_Make2d " + "_D " + "_U " + "_M=はい " + "_Enter")
				rs.Command("_Unlock")
				rs.Command("_SelCrv")
				rs.Command("-_Make2d " + "_D " + "_C " + "_M=はい " + "_Enter")
				rs.Command("_CPlane " + "_W " + "_T ")
				if ext == "dwg":
					rs.Command("-_Export " + dir + nam + "_roof" + ".dwg" + " " + "_Enter")
				else:
					rs.Command("-_Export " + dir + nam + "_roof" + "." + str(ext))
				rs.Command("_SelCrv")
				rs.Command("_Delete")
			rs.Command("_Unlock")
			rs.Command("_Show")
		print("time = " + str(time.time() - s))

	# リセットする
	def Reset():
		print("■start reset■")
		sc.doc = Rhino.RhinoDoc.ActiveDoc
		rs.PurgeLayer("Make2D")
		sc.doc = ghdoc
		rs.Command("_CPlane " + "_W " + "_T ")
		rs.Command("_Setview " + "_W " + "_P ")
		rs.Command("_SelLight")
		rs.Command("_SelPt")
		rs.Command("_SelCrv")
		rs.Command("_Invert")
		rs.Command("_Zoom " + "_S ")
		rs.Command("_SelNone")
		print("■end reset■")

	#/////////////////////////////////////////////////////////////////////////
	# 作図の全体の流れ
	#/////////////////////////////////////////////////////////////////////////
	if ConfirmLayer():# Make2Dレイヤーの存在を確認
		if Confirmfolder(directory):# フォルダの存在を確認
			if ConfirmDup(directory, name, height, curve_s, mode, extension):# ファイルの重複を確認
				rs.Command("_CPlane " + "_W " + "_T ")
				rs.Command("_Show")
				rs.Command("_SelLight")
				rs.Command("_SelPt")
				rs.Command("_SelCrv")
				rs.Command("_Lock")
				if mode == 0 or mode == 2:# 平面図作成
					print("■start makeplan■")
					MakePlan(height, center, directory, name, speed, extension)
					print("■end makeplan■")
				if mode == 1 or mode == 2:# 断面図作成
					print("■start makesection■")
					count = 0
					while count != len(curve_s):
						print("making no." + str(count) + " section")
						sectionline = curve_s[count]
						if len(rs.ExplodeCurves(sectionline)) == 0:# 折れ曲がらない断面線のとき
							print("this is simple sectionline")
							MakeSimpleSec(directory, name, count, sectionline, speed, extension)
						else:# 複雑な断面線のとき
							print("this is complex sectionline")
							MakeComplexSec(directory, name, count, sectionline, speed, extension)
						print("completed no." + str(count) + " section")
						count += 1
					print("■end makesection■")
				rs.Command("_Unlock")
				if mode == 3:# 配置図作成
					print("■start makeroofplan■")
					MakeRoofPlan(directory, name, speed, extension)
					print("■end makeroofplan■")
				print("//////////end drawing//////////")
				Reset()
# ---------- end python ----------
tb_7 = CreateTextBlock(Text=python.len_s, TextSize=12, Justification=0)
tb_8 = CreateTextBlock(Text=python.len_p, TextSize=12, Justification=0)
join = TextJoin(Text=python.out)
textbox_3 = CreateTextBox(DefaultText=join, UpdateButton=False, showLabel=True)
hideshow_7 = HideShowElement(ElementToHideShow=tb_8, Show=bool, Collapse=True, Disable=False)
hideshow_8 = HideShowElement(ElementToHideShow=tb_7, Show=bool_2, Collapse=True, Disable=False)
data_27 = Data(textbox_3)
data_28 = Data(tb_8)
data_29 = Data(tb_7)
adjustelem_3 = AdjustElementAppearance(ElementsToAdjust=[data_29, data_28], Foreground=ColourSwatch(SwatchColor=RGB(3, 3, 3)))

# ---- group: 中央配置
adjustpos_4 = AdjustElementPositioning(ElementsToAdjust=[tb_8, tb_7, data_9, data_17, data_18], AbsolutePositioning=False, HorizontalAlignment=1)

# ----
entwine = Entwine(
    Branch00=data_10,
    Branch01=data_11,
    Branch02=data_2,
    Branch03=data_3,
    Branch04=data_28,
    Branch05=data_4,
    Branch06=data_5,
    Branch07=data_12,
    Branch08=data_29,
    Branch09=data_13,
    Branch010=data_14,
    Branch011=data_15,
    Branch012=data_6,
    Branch013=data_16,
    Branch014=data_7,
    Branch015=data_8,
    Branch016=data_9,
    Branch017=data_18,
    Branch018=data_17,
    FlattenInputs=True)
entwine_2 = Entwine(Branch00=data_27, FlattenInputs=True)

# ---- group: サーフェス大きさ
data_30 = Data(data_20)

# ----
tabs = TabbedView(TabNames=panel_5, TabTextSize=Slider(20, range=0..100), Tab0=flatten(entwine), Tab1=flatten(entwine_2))
rectangle = Rectangle(Plane=python.center, XSize=data_30, YSize=data_30, Radius=0)  # -> Rectangle, Length
data_31 = Data(launchwin)
boundary = BoundarySurfaces(Edges=rectangle.Rectangle)
addelems = AddElements(Window=data_31, Elements=flatten(tabs), DoVLChecking=True)  # -> AddedElements, ElementNames
panel_6 = Panel(python.out)
