# Grasshopper definition sectiondrawer.gh (Grasshopper 0.9.76)
# plug-ins: Python Interpreter, Human UI

# ---- group: ウィンドウ展開
run = BooleanToggle(True)

# ---- group: 切断線
crv = Curve(reparameterize([<curve referenced from the Rhino model> x2]))

# ---- group: 高さ0として扱う点
pt = Point(<point referenced from the Rhino model>)

# ----
radiobtn = CreateRadioButton(RadioButtonName="配置図(断面位置図)", RadioButtonGroup="モード選択", InitiallySelected=False)
radiobtn_2 = CreateRadioButton(RadioButtonName="平面図のみ", RadioButtonGroup="モード選択", InitiallySelected=True)
radiobtn_3 = CreateRadioButton(RadioButtonName="断面図のみ", RadioButtonGroup="モード選択", InitiallySelected=False)
radiobtn_4 = CreateRadioButton(RadioButtonName="平面図＆断面図", RadioButtonGroup="モード選択", InitiallySelected=False)
tb = CreateTextBlock(Text="□モード選択ーーーーーーーーーーーーーーーーーーーーーーー", TextSize=16, Justification=0)
values = ValueListener(Elements=radiobtn_2, SomeProperty=True)  # -> Values, Indices
values_2 = ValueListener(Elements=radiobtn_3, SomeProperty=True)  # -> Values, Indices
values_3 = ValueListener(Elements=radiobtn_4, SomeProperty=True)  # -> Values, Indices
values_4 = ValueListener(Elements=radiobtn, SomeProperty=True)  # -> Values, Indices
merge = Merge(Data1=values.Values, Data2=values_2.Values, Data3=values_3.Values, Data4=values_4.Values)
toggle = BooleanToggle(True)
toggle_2 = BooleanToggle(False)
mindex = MemberIndex(Set=merge, Member=Toggle(True))  # -> Index, Count
stack = CreateStack(UIElements=[radiobtn_4, radiobtn], Horizontal=True)
stack_2 = CreateStack(UIElements=[radiobtn_2, radiobtn_3], Horizontal=True)
merge_2 = Merge(Data1=toggle, Data2=toggle)
merge_3 = Merge(Data1=toggle, Data2=toggle_2)
merge_4 = Merge(Data1=toggle_2, Data2=toggle)
merge_5 = Merge(Data1=toggle_2, Data2=toggle_2)
サーフェスの大きさ = Slider(50000, range=-1..1000000)
filter = StreamFilter(Gate=mindex.Index, Stream0=merge_3, Stream1=merge_4, Stream2=merge_2, Stream3=merge_5)
item = ListItem(List=filter, Index=0, Wrap=True)  # -> Item, Item1
目印の大きさ = Slider(29, range=5..100)
panel = Panel("""dwg
3dm""")
slider = CreateSlider(
    Slider=サーフェスの大きさ,
    SnapValue=Slider(10000, range=0..10000),
    ShowBounds=False,
    showLabel=False,
    ShowTicks=False,
    ShowTooltip=False,
    ShowValLabel=False)
bool = Boolean(item.Item)
bool_2 = Boolean(item.Item1)
radiobtn_5 = CreateRadioButton(RadioButtonName="精度優先", RadioButtonGroup="スピード選択", InitiallySelected=False)
radiobtn_6 = CreateRadioButton(RadioButtonName="速度優先", RadioButtonGroup="スピード選択", InitiallySelected=True)
slider_2 = CreateSlider(Slider=目印の大きさ, ShowBounds=False, showLabel=False, ShowTicks=False, ShowTooltip=False, ShowValLabel=False)
cmdbutton = CreateRhinoCommandButton(ButtonName="AcadSchemes", RhinoScript="AcadSchemes", ButtonStyle=0)
filepicker = CreateFilePicker(ButtonLabelText="browse", DialogType=2, MustExist=True, Filter="All Files|*.*")
textbox = CreateTextBox(DefaultText="project", UpdateButton=True, showLabel=False)
tb_2 = CreateTextBlock(Text="□設定ーーーーーーーーーーーーーーーーーーーーーーーーーー", TextSize=16, Justification=0)
pulldown = CreatePulldownMenu(ListItems=panel, showLabel=True)
tb_3 = CreateTextBlock(Text="□実行ーーーーーーーーーーーーーーーーーーーーーーーーーーー", TextSize=16, Justification=0)
textbox_2 = CreateTextBox(DefaultText="-1500/0/1500", UpdateButton=True, showLabel=True)
expander = CreateExpander(UIElements=slider, Header="目印の大きさ", Open=False)
tb_4 = CreateTextBlock(Text="□断面図ーーーーーーーーーーーーーーーーーーーーーーーーー", TextSize=16, Justification=0)
values_5 = ValueListener(Elements=slider, SomeProperty=True)  # -> Values, Indices
expander_2 = CreateExpander(UIElements=slider_2, Header="目印の大きさ", Open=False)
values_6 = ValueListener(Elements=textbox_2, SomeProperty=True)  # -> Values, Indices
tb_5 = CreateTextBlock(Text="□平面図ーーーーーーーーーーーーーーーーーーーーーーーーー", TextSize=16, Justification=0)
expander_3 = CreateExpander(UIElements=textbox_2, Header="高さの指定", Open=False)
dam = DataDam(DataA=values_5.Values, BufferDelay=10000000, BufferMode=2)
values_7 = ValueListener(Elements=radiobtn_6, SomeProperty=True)  # -> Values, Indices
values_8 = ValueListener(Elements=radiobtn_5, SomeProperty=True)  # -> Values, Indices
stack_3 = CreateStack(UIElements=[radiobtn_6, radiobtn_5], Horizontal=True)
setslider = SetSlider(UISlider=slider, Value=values_5.Values)
expander_4 = CreateExpander(UIElements=textbox, Header="保存名", Open=False)
expander_5 = CreateExpander(UIElements=filepicker, Header="保存先", Open=False)
values_9 = ValueListener(Elements=textbox, SomeProperty=True)  # -> Values, Indices
values_10 = ValueListener(Elements=filepicker, SomeProperty=True)  # -> Values, Indices
expander_6 = CreateExpander(UIElements=pulldown, Header="保存形式", Open=False)
values_11 = ValueListener(Elements=pulldown, SomeProperty=True)  # -> Values, Indices
values_12 = ValueListener(Elements=slider_2, SomeProperty=True)  # -> Values, Indices
expander_7 = CreateExpander(UIElements=cmdbutton, Header="dwgに書き出す設定を変更する", Open=False)
merge_6 = Merge(Data1=values_7.Values, Data2=values_8.Values)
division = Division(A=dam, B=2)
split = TextSplit(Text=values_6.Values, Separators="/")
setslider_2 = SetSlider(UISlider=slider_2, Value=values_12.Values)
panel_2 = Panel("""slow
fast""")
dam_2 = DataDam(DataA=values_12.Values, BufferDelay=10000000, BufferMode=2)
neg = Negative(Value=division)
toggle_3 = CreateToggle(Default=False, OnLabel=" on", OffLabel=" off")
mindex_2 = MemberIndex(Set=merge_6, Member=Toggle(False))  # -> Index, Count
int = Integer(split)
len = TextLength(Text=values_10.Values)
dom = ConstructDomain(DomainStart=division, DomainEnd=neg)
equals = Equality(FirstNumber=len, SecondNumber="0")  # -> Equality, Inequality
item_2 = ListItem(List=panel_2, Index=mindex_2.Index, Wrap=True)
filter_2 = StreamFilter(Gate=equals.Equality, Stream0=values_10.Values, Stream1="D:\default\")
txt = Text(item_2)
values_13 = ValueListener(Elements=toggle_3, SomeProperty=True)  # -> Values, Indices
tb_6 = CreateTextBlock(Text="offにしてください", TextSize=12, Justification=0)
concat = Concatenate(FragmentA=filter_2, FragmentB="\")
bool_3 = Boolean(values_13.Values)
adjustelem = AdjustElementAppearance(
    ElementsToAdjust=tb_6,
    Foreground=ColourSwatch(SwatchColor=RGB(255, 255, 255)),
    Background=ColourSwatch(SwatchColor=RGB(255, 0, 0)))
hideshow = HideShowElement(ElementToHideShow=tb_6, Show=bool_3, Collapse=True, Disable=False)
accent_colors = ValueList({"Amber", "Blue", "Brown", "Cobalt", "Crimson", "Cyan", "Emerald", "Green", "Indigo", "Lime", "Magenta", "Mauve", "Olive", "Orange", "Pink", "Purple", "Red", "Sienna", "Steel", "Taupe", "Teal", "Violet", "Yellow"}, selected="Steel")
hideshow_2 = HideShowElement(ElementToHideShow=tb_5, Show=bool, Collapse=True, Disable=False)
hideshow_3 = HideShowElement(ElementToHideShow=expander_3, Show=bool, Collapse=True, Disable=False)
hideshow_4 = HideShowElement(ElementToHideShow=expander, Show=bool, Collapse=True, Disable=False)
hideshow_5 = HideShowElement(ElementToHideShow=tb_4, Show=bool_2, Collapse=True, Disable=False)
hideshow_6 = HideShowElement(ElementToHideShow=expander_2, Show=bool_2, Collapse=True, Disable=False)
launchwin = LaunchWindow(
    Show=run,
    Name="Plan&Section",
    Width=Slider(370, range=0..1000),
    Height=Slider(690, range=0..1000),
    ChildStatus=0,
    EnableHorizScroll=False)

# ---- group: モード
data = Data(mindex.Index)

# ----
winprops = SetWindowProperties(Window=launchwin, Theme=0, AccentColor=accent_colors, ShowTitleBar=True, ScaleFactor=1)
data_2 = Data(stack)
data_3 = Data(tb_5)
data_4 = Data(expander_3)
data_5 = Data(expander)
data_6 = Data(expander_5)
data_7 = Data(expander_7)
data_8 = Data(tb_3)
data_9 = Data(stack_3)
data_10 = Data(tb)
data_11 = Data(stack_2)
data_12 = Data(tb_4)
data_13 = Data(expander_2)
data_14 = Data(tb_2)
data_15 = Data(expander_4)
data_16 = Data(expander_6)
data_17 = Data(toggle_3)
data_18 = Data(tb_6)

# ---- group: 平面図高さ
data_19 = Data(int)

# ---- group: サーフェス大きさ
data_20 = Data(dom)

# ---- group: 実行
data_21 = Data(bool_3)

# ---- group: 速度か精度か
data_22 = Data(txt)

# ---- group: 保存形式
data_23 = Data(values_11.Values)

# ---- group: ディレクトリ
data_24 = Data(concat)

# ---- group: 保存名
data_25 = Data(values_9.Values)

# ---- group: 断面図目印
data_26 = Data(dam_2)

# ----
panel_3 = Panel("""C:以外を指定すること
英数字・記号のみ使用可能""")
panel_4 = Panel("""選択した点の高さを0として平面図を作成する高さを指定する。
○○○/×××/▲▲▲のかたちで記入。""")
tooltip = AttachTooltipToElement(ElementsToAttachTo=data_13, TooltipContent="断面を見る方向の目印の大きさを指定。", ShowDelay=500, Duration=20000)
tooltip_2 = AttachTooltipToElement(ElementsToAttachTo=data_15, TooltipContent="英数字・記号のみ使用可能", ShowDelay=500, Duration=20000)
tooltip_3 = AttachTooltipToElement(ElementsToAttachTo=data_6, TooltipContent=panel_3, ShowDelay=500, Duration=20000)
tooltip_4 = AttachTooltipToElement(ElementsToAttachTo=data_4, TooltipContent=panel_4, ShowDelay=500, Duration=20000)
tooltip_5 = AttachTooltipToElement(ElementsToAttachTo=data_5, TooltipContent="高さの目印になるサーフェスの大きさを指定。", ShowDelay=500, Duration=20000)
crv_2 = Curve(crv)
lng = ListLength(List=crv_2)
end = EndPoints(Curve=crv_2)  # -> Start, End
series = Series(Start=0, Step=1, Count=lng)
xy = XYPlane(Origin=Point(0, 0, 0))
merge_7 = Merge(Data1=graft(end.Start), Data2=graft(end.End))
int_2 = Integer(series)
project = Project(Geometry=crv, Plane=xy)  # -> Geometry, Transform
tag = TextTag3D(Location=merge_7, Text=graft(int_2), Size=Slider(4010, range=0..4010), Justification=7)
crv_3 = Curve(project.Geometry)

# ---- group: よこ
adjustpos = AdjustElementPositioning(
    ElementsToAdjust=[data_4, data_5, data_13, data_15, data_6, data_16, data_7],
    Margin=Slider(4, range=0..10),
    AbsolutePositioning=False,
    Width=Slider(320, range=0..1000),
    HorizontalAlignment=0)

# ----
adjustelem_2 = AdjustElementAppearance(
    ElementsToAdjust=[data_3, data_12, data_14, data_9, data_10, data_8],
    Foreground=ColourSwatch(SwatchColor=RGB(163, 0, 0)))

# ---- group: ディレクトリ
adjustpos_2 = AdjustElementPositioning(
    ElementsToAdjust=filepicker,
    Margin=Slider(4, range=0..100),
    AbsolutePositioning=False,
    Width=Slider(300, range=0..1000),
    Height=Slider(35, range=0..1000),
    HorizontalAlignment=0)

# ---- group: 中身
adjustpos_3 = AdjustElementPositioning(
    ElementsToAdjust=textbox,
    AbsolutePositioning=False,
    Width=Slider(300, range=0..1000),
    Height=Slider(27, range=0..1000),
    HorizontalAlignment=0)

# ----
crv_4 = Curve(project.Geometry)
pt_2 = Point(pt)
file = ReadFile(File="D:\python\sectiondrawer\sectiondrawer\sectiondrawer.py", PerLineParse=False)
panel_5 = Panel("""main
debug""")
python = PythonScript(
    Code=file,
    Point_p=pt_2,
    Curve_s=crv_4,
    Mode=data,
    Height=data_19,
    Mark=data_26,
    Name=data_25,
    Directory=data_24,
    Extension=data_23,
    Speed=data_22,
    Draw=data_21)  # -> Out, Direction, Center, Len_p, Len_s
tb_7 = CreateTextBlock(Text=python.Len_s, TextSize=12, Justification=0)
tb_8 = CreateTextBlock(Text=python.Len_p, TextSize=12, Justification=0)
join = TextJoin(Text=python.Out)
textbox_3 = CreateTextBox(DefaultText=join, UpdateButton=False, showLabel=True)
hideshow_7 = HideShowElement(ElementToHideShow=tb_8, Show=bool, Collapse=True, Disable=False)
hideshow_8 = HideShowElement(ElementToHideShow=tb_7, Show=bool_2, Collapse=True, Disable=False)
data_27 = Data(textbox_3)
data_28 = Data(tb_8)
data_29 = Data(tb_7)
adjustelem_3 = AdjustElementAppearance(ElementsToAdjust=[data_29, data_28], Foreground=ColourSwatch(SwatchColor=RGB(3, 3, 3)))

# ---- group: 中央配置
adjustpos_4 = AdjustElementPositioning(ElementsToAdjust=[tb_8, tb_7, data_9, data_17, data_18], AbsolutePositioning=False, HorizontalAlignment=1)

# ----
entwine = Entwine(
    Branch00=data_10,
    Branch01=data_11,
    Branch02=data_2,
    Branch03=data_3,
    Branch04=data_28,
    Branch05=data_4,
    Branch06=data_5,
    Branch07=data_12,
    Branch08=data_29,
    Branch09=data_13,
    Branch010=data_14,
    Branch011=data_15,
    Branch012=data_6,
    Branch013=data_16,
    Branch014=data_7,
    Branch015=data_8,
    Branch016=data_9,
    Branch017=data_18,
    Branch018=data_17,
    FlattenInputs=True)
entwine_2 = Entwine(Branch00=data_27, FlattenInputs=True)

# ---- group: サーフェス大きさ
data_30 = Data(data_20)

# ----
tabs = TabbedView(TabNames=panel_5, TabTextSize=Slider(20, range=0..100), Tab0=flatten(entwine), Tab1=flatten(entwine_2))
rectangle = Rectangle(Plane=python.Center, XSize=data_30, YSize=data_30, Radius=0)  # -> Rectangle, Length
data_31 = Data(launchwin)
boundary = BoundarySurfaces(Edges=rectangle.Rectangle)
addelems = AddElements(Window=data_31, Elements=flatten(tabs), DoVLChecking=True)  # -> AddedElements, ElementNames
panel_6 = Panel(python.Out)
